% Simulink data dictionary MotorControlDataDictionary_Math.sldd

MC_Hardawre_Chip_PreDrive = Simulink.Parameter(0, StorageClass="Const", DataType="double", Min=0, Max=0)  % 硬件预驱类型
MC_Hardawre_Chip_Type = Simulink.Parameter(0, StorageClass="Const", DataType="double", Min=0, Max=0)  % 硬件MCU类型
MC_Hardware_Chip_ADCClock = Simulink.Parameter(0, StorageClass="Const", DataType="double", Min=0, Max=0)  % 硬件ADC时钟
MC_Hardware_Chip_ADCKeepPeriod = Simulink.Parameter(0, StorageClass="Const", DataType="double", Min=0, Max=0)  % 硬件ADC采样保持周期
MC_Hardware_Chip_ADCResultBit = Simulink.Parameter(0, StorageClass="Const", DataType="double", Min=0, Max=0)  % 硬件ADC位数
MC_Hardware_Chip_ADCSamplePeriod = Simulink.Parameter(0, StorageClass="Const", DataType="double", Min=0, Max=0)  % 硬件ADC采样周期
MC_Hardware_Chip_ADCTransPeriod = Simulink.Parameter(0, StorageClass="Const", DataType="double", Min=0, Max=0)  % 硬件ADC转换周期
MC_Hardware_Chip_ADCVoltageMax = Simulink.Parameter(1, StorageClass="Const", DataType="double", Min=0, Max=100)  % 硬件ADC最大电压
MC_Hardware_Chip_ADCVoltageRefence = Simulink.Parameter(0, StorageClass="Const", DataType="double", Min=0, Max=0)  % 硬件ADC参考电压
MC_Hardware_Chip_CSAFlag = Simulink.Parameter(0, StorageClass="Const", DataType="double", Min=0, Max=0)  % 硬件CSA标志位
MC_Hardware_Chip_CSAGain = Simulink.Parameter(1, StorageClass="Const", DataType="double", Min=0, Max=0)  % 硬件CSA放大倍数
MC_Hardware_Chip_Clock = Simulink.Parameter(0, StorageClass="Const", DataType="double", Min=0, Max=0)  % 硬件MCU主时钟
MC_Hardware_Chip_PWMPeriod = Simulink.Parameter(0, StorageClass="Const", DataType="double", Min=0, Max=0)  % 硬件PWM周期
MC_Hardware_Diode_Lon = Simulink.Parameter(0, StorageClass="Const", DataType="double", Min=0, Max=1)  % 硬件整流二极管电感
MC_Hardware_Diode_Rds = Simulink.Parameter(0.001, StorageClass="Const", DataType="double", Min=0, Max=1)  % 硬件整流二极管内阻
MC_Hardware_Diode_SC = Simulink.Parameter(2.5e-9, StorageClass="Const", DataType="double", Min=0, Max=1)  % 硬件整流二极管并联电容
MC_Hardware_Diode_SR = Simulink.Parameter(500, StorageClass="Const", DataType="double", Min=0, Max=1000)  % 硬件整流二极管并联电阻
MC_Hardware_Diode_Vf = Simulink.Parameter(0.8, StorageClass="Const", DataType="double", Min=0, Max=1)  % 硬件整流二极管导通电压
MC_Hardware_IGBT_DeadTime = Simulink.Parameter(0, StorageClass="Const", DataType="double", Min=0, Max=0)  % 硬件IGBT死区时间
MC_Hardware_IGBT_Lon = Simulink.Parameter(0, StorageClass="Const", DataType="double", Min=0, Max=1)  % 硬件IGBT管电感
MC_Hardware_IGBT_Rds = Simulink.Parameter(0.001, StorageClass="Const", DataType="double", Min=0, Max=1)  % 硬件IGBT管内阻
MC_Hardware_IGBT_SC = Simulink.Parameter(2.5e-9, StorageClass="Const", DataType="double", Min=0, Max=1)  % 硬件IGBT并联电容
MC_Hardware_IGBT_SR = Simulink.Parameter(500, StorageClass="Const", DataType="double", Min=0, Max=1000)  % 硬件IGBT并联电阻
MC_Hardware_IGBT_Vf = Simulink.Parameter(0.8, StorageClass="Const", DataType="double", Min=0, Max=1)  % 硬件IGBT导通电压
MC_Hardware_Input_IbusMax = Simulink.Parameter(0, StorageClass="Const", DataType="double", Min=0, Max=0)  % 母线电流最大值
MC_Hardware_Input_Vac = Simulink.Parameter(0, StorageClass="Const", DataType="double", Min=0, Max=0)  % 硬件额定电压
MC_Hardware_Input_VbusMax = Simulink.Parameter(0, StorageClass="Const", DataType="double", Min=0, Max=0)  % 硬件最大电压
MC_Hardware_Input_VbusMin = Simulink.Parameter(0, StorageClass="Const", DataType="double", Min=0, Max=0)  % 硬件最小电压
MC_Hardware_Sample_CurrentType = Simulink.Parameter(3, StorageClass="Const", DataType="double", Min=0, Max=0)  % 硬件相电流采样方式
MC_Hardware_Sample_Resistor = Simulink.Parameter(0.001, StorageClass="Const", DataType="double", Min=0, Max=0)  % 硬件相电流采样电阻
MC_Hardware_Sample_VPhaseSampleFlag = Simulink.Parameter(0, StorageClass="Const", DataType="double", Min=0, Max=0)  % 硬件相电压采样
MC_Hardware_Sample_VbusSamplePeriod = Simulink.Parameter(0, StorageClass="Const", DataType="double", Min=0, Max=0)  % 硬件直流母线电压采样周期
MC_Hardware_Senseor_AngleFlag = Simulink.Parameter(0, StorageClass="Const", DataType="double", Min=0, Max=0)  % 硬件位置传感器
MC_Hardware_Senseor_AngleSamplePeriod = Simulink.Parameter(0, StorageClass="Const", DataType="double", Min=0, Max=0)  % 硬件位置传感器采样周期
MC_Hardware_Senseor_AngleSignal = Simulink.Parameter(0, StorageClass="Const", DataType="double", Min=0, Max=0)  % 硬件位置传感器信号类型
MC_Hardware_Senseor_AngleType = Simulink.Parameter(0, StorageClass="Const", DataType="double", Min=0, Max=0)  % 硬件位置传感器类型
MC_Hardware_Senseor_TorqueFlag = Simulink.Parameter(0, StorageClass="Const", DataType="double", Min=0, Max=0)  % 硬件扭矩传感器
MC_Hardware_Senseor_TorqueSamplePeriod = Simulink.Parameter(0, StorageClass="Const", DataType="double", Min=0, Max=0)  % 硬件扭矩传感器采样周期
MC_Hardware_Senseor_TorqueSignal = Simulink.Parameter(0, StorageClass="Const", DataType="double", Min=0, Max=0)  % 硬件扭矩传感器信号
MC_Hardware_Senseor_TorqueType = Simulink.Parameter(0, StorageClass="Const", DataType="double", Min=0, Max=0)  % 硬件扭矩传感器类型
MC_MotorModel_Machine_Damp = Simulink.Parameter(0, StorageClass="Const", DataType="double", Min=0, Max=1)  % 电机本体转动阻尼
MC_MotorModel_Machine_Ineria = Simulink.Parameter(0, StorageClass="Const", DataType="double", Min=0, Max=1)  % 电机本体转动惯量
MC_MotorModel_Machine_TfCoff = Simulink.Parameter(0, StorageClass="Const", DataType="double", Min=0, Max=1)  % 电机机械动阻力系数
MC_MotorModel_Machine_Tfric = Simulink.Parameter(0, StorageClass="Const", DataType="double", Min=0, Max=1)  % 电机本体静摩擦力矩
MC_MotorModel_Magentic_Ke = Simulink.Parameter(0, StorageClass="Const", DataType="double", Min=0, Max=1)  % 电机本体反电势系数
MC_MotorModel_Magentic_Psi = Simulink.Parameter(0, StorageClass="Const", DataType="double", Min=0, Max=1)  % 电机本体转子磁链

MC_MotorModel_ModelType = Simulink.Parameter(0, StorageClass="Const", DataType="double", Min=0, Max=1)  % 电机模型类型
  % （注）

MC_MotorModel_PowerMax = Simulink.Parameter(0, StorageClass="Const", DataType="double", Min=0, Max=1)  % 电机输入最大功率
MC_MotorModel_Rotor_Pn = Simulink.Parameter(4, StorageClass="Const", DataType="double", Min=0, Max=48)  % 电机极对数
MC_MotorModel_SpeedBase = Simulink.Parameter(0, StorageClass="Const", DataType="double", Min=0, Max=1)  % 电机机械额定转速
MC_MotorModel_SpeedMax = Simulink.Parameter(0, StorageClass="Const", DataType="double", Min=0, Max=1)  % 电机机械最大转速
MC_MotorModel_Stator_L0 = Simulink.Parameter(0, StorageClass="Const", DataType="double", Min=0, Max=1)  % 电机定子零序电感
MC_MotorModel_Stator_La = Simulink.Parameter(0, StorageClass="Const", DataType="double", Min=0, Max=1)  % 电机定子A相电感
MC_MotorModel_Stator_Lab = Simulink.Parameter(0, StorageClass="Const", DataType="double", Min=0, Max=1)  % 电机定子Alpha/Beta互电感
MC_MotorModel_Stator_Lalpha = Simulink.Parameter(0, StorageClass="Const", DataType="double", Min=0, Max=1)  % 电机定子Alpha轴电感
MC_MotorModel_Stator_Lb = Simulink.Parameter(0, StorageClass="Const", DataType="double", Min=0, Max=1)  % 电机定子B相电感
MC_MotorModel_Stator_Lbeta = Simulink.Parameter(0, StorageClass="Const", DataType="double", Min=0, Max=1)  % 电机定子Beta轴电感
MC_MotorModel_Stator_Lc = Simulink.Parameter(0, StorageClass="Const", DataType="double", Min=0, Max=1)  % 电机定子C相电感
MC_MotorModel_Stator_Ld = Simulink.Parameter(0, StorageClass="Const", DataType="double", Min=0, Max=1)  % 电机定子D轴电感
MC_MotorModel_Stator_Lq = Simulink.Parameter(0, StorageClass="Const", DataType="double", Min=0, Max=1)  % 电机定子Q轴电感
MC_MotorModel_Stator_Ra = Simulink.Parameter(1, StorageClass="Const", DataType="double", Min=0, Max=1)  % 电机定子A相电阻
MC_MotorModel_Stator_Ralpha = Simulink.Parameter(0, StorageClass="Const", DataType="double", Min=0, Max=1)  % 电机定子Alpha轴电阻
MC_MotorModel_Stator_Rb = Simulink.Parameter(1, StorageClass="Const", DataType="double", Min=0, Max=1)  % 电机定子B相电阻
MC_MotorModel_Stator_Rbeta = Simulink.Parameter(0, StorageClass="Const", DataType="double", Min=0, Max=1)  % 电机定子Beta轴电阻
MC_MotorModel_Stator_Rc = Simulink.Parameter(1, StorageClass="Const", DataType="double", Min=0, Max=1)  % 电机定子C相电阻
MC_MotorModel_Stator_Rd = Simulink.Parameter(0, StorageClass="Const", DataType="double", Min=0, Max=1)  % 电机定子D轴电阻
MC_MotorModel_Stator_Rq = Simulink.Parameter(0, StorageClass="Const", DataType="double", Min=0, Max=1)  % 电机定子Q轴电阻
MC_MotorModel_Stator_Rs = Simulink.Parameter(1, StorageClass="Const", DataType="double", Min=0, Max=1)  % 电机定子均值相电阻

MC_MotorModel_WindingType = Simulink.Parameter(0, StorageClass="Const", DataType="double", Min=0, Max=1)  % 电机绕组类型
  % （注：数学模型只有Y型）

MC_Sim_BaseFreq = Simulink.Parameter(40000000, StorageClass="Const", DataType="double", Min=0, Max=1000000000)  % 基础时钟频率
MC_Sim_BaseStep = Simulink.Parameter(2.5e-8, StorageClass="Const", DataType="double", Min=0, Max=6.6675e-07)  % 基础任务步长
MC_Sim_HFTFreq = Simulink.Parameter(15000, StorageClass="Const", DataType="double", Min=0, Max=400000)  % 高频任务频率
MC_Sim_HFTStep = Simulink.Parameter(6.6675e-5, StorageClass="Const", DataType="double", Min=0, Max=0.000200025)  % 高频任务步长
MC_Sim_MFTFreq = Simulink.Parameter(500, StorageClass="Const", DataType="double", Min=0, Max=1500)  % 中频任务频率
MC_Sim_MFTStep = Simulink.Parameter(0.00200025, StorageClass="Const", DataType="double", Min=0, Max=1)  % 中频任务步长
MC_Sim_NoisePower_IACbus = Simulink.Parameter(0, StorageClass="Const", DataType="double", Min=0, Max=1)  % 交流母线电流采样噪声
MC_Sim_NoisePower_IDCbus = Simulink.Parameter(0, StorageClass="Const", DataType="double", Min=0, Max=1)  % 直流母线电流采样噪声
MC_Sim_NoisePower_PhaseCurrent = Simulink.Parameter(0, StorageClass="Const", DataType="double", Min=0, Max=1)  % 相电流采样噪声
MC_Sim_NoisePower_PhaseVoltage = Simulink.Parameter(0, StorageClass="Const", DataType="double", Min=0, Max=1)  % 相电压采样噪声
MC_Sim_NoisePower_PositionSensor = Simulink.Parameter(0, StorageClass="Const", DataType="double", Min=0, Max=1)  % 位置传感器采样噪声
MC_Sim_NoisePower_SpeedSensor = Simulink.Parameter(0, StorageClass="Const", DataType="double", Min=0, Max=1)  % 转速传感器采样噪声
MC_Sim_NoisePower_Tempature = Simulink.Parameter(0, StorageClass="Const", DataType="double", Min=0, Max=1)  % 温度采样噪声
MC_Sim_NoisePower_TorqueSensor = Simulink.Parameter(0, StorageClass="Const", DataType="double", Min=0, Max=1)  % 力矩传感器采样噪声
MC_Sim_NoisePower_VACbus = Simulink.Parameter(0, StorageClass="Const", DataType="double", Min=0, Max=1)  % 交流母线电压采样噪声
MC_Sim_NoisePower_VDCbus = Simulink.Parameter(0, StorageClass="Const", DataType="double", Min=0, Max=1)  % 直流母线电压采样噪声
MotorModelType = 1